# Grasshopper definition final.gh (Grasshopper 1.0.7)
# plug-ins: Firefly.Core

ports_available = COMPortsAvailable()

# ---- group: Read Arduino output from Serial port
port_index = Panel("2")
toggle = BooleanToggle(True)
baud_rate = Panel("9600")
item = ListItem(List=ports_available, Index=port_index, Wrap=True)
timer = Timer(TimerInterval=200, Target=read)
open_port = OpenClosePort(OpenClosePort=toggle, PortNumber=item, BaudRate=baud_rate)
read = SerialReadGeneric(StartReadingValues=toggle, PortNumber=item)  # -> SerialOutput, StatusMessage
open_port_errors = Panel(open_port)
serial_read = Panel(read.SerialOutput)
read_errors = Panel(read.StatusMessage)

# ----
panel = Panel(ports_available)
toggle_2 = BooleanToggle(True)
crv = Curve(<curve referenced from the Rhino model>)
area = Area(Geometry=crv)  # -> Area, Centroid
pdecon = Deconstruct(Point=area.Centroid)  # -> XComponent, YComponent, ZComponent
timer_2 = Timer(TimerInterval=100, Target=[create_voronoi, new_point])
subtraction = Subtraction(A=pdecon.YComponent, B=Slider(10, range=0..10))
width = Panel("100")
height = Panel("100")

panel_2 = Panel("C:\Users\user\Documents\2nd\HCI\final project\")
process_serial = GhPythonScript(x=serial_read)  # -> out, new_game, rho, theta, player, place_point
# ---------- process_serial: Python ----------
__author__ = "student"
__version__ = "2019.03.07"

import rhinoscriptsyntax as rs
from math import pi

r = x.split(',')
rho = float(r[0])
theta = (float(r[1]) * pi) / 180
player = int(r[2])

new_game = False
place_point = False

if player == -2:
    new_game = True
elif player != -1:
    place_point = True
# ---------- end process_serial ----------
get_last_point = PythonScript(dir_path=panel_2, cur_player=process_serial.player)  # -> out, x, y
# ---------- get_last_point: Python ----------
__author__ = "carlveksler"

import rhinoscriptsyntax as rs

X = 0
Y = 1

with open(dir_path + 'p.txt', 'r') as f:
        points = f.readlines()

p = points[-2].split(',')

x = p[X]
y = p[Y]
# ---------- end get_last_point ----------
new_point = PythonScript(rho=process_serial.rho, theta=process_serial.theta, last_x=get_last_point.x, last_y=get_last_point.y)  # -> x, y
# ---------- new_point: Python ----------
__author__ = "carlveksler"

import rhinoscriptsyntax as rs
import math

r = rho
l_x = float(last_x)
l_y = float(last_y)

r_x = r * math.cos(theta) + l_x
r_y = r* math.sin(theta) + l_y

while r_x > 100 or r_x < 0 or r_y > 100 or r_y < 0:
    r /= 2
    r_x = r * math.sin(theta) + l_x
    r_y = r* math.cos(theta) + l_y
    
x = int(r_x)
y = int(r_y)
# ---------- end new_point ----------
create_voronoi = GhPythonScript(
    H=height,
    W=width,
    n_game=process_serial.new_game,
    x=new_point.x,
    y=new_point.y,
    cur_player=process_serial.player,
    write=process_serial.place_point,
    dir_path=panel_2)  # -> out, p_0_x, p_0_y, p_0_r, p_0_g, p_0_b, p_1_x, p_1_y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
# ---------- create_voronoi: Python ----------
__author__ = "student"
__version__ = "2019.03.05"

import rhinoscriptsyntax as rs
from random import randint
from math import floor

X = 0
Y = 1
R = 2
G = 3
B = 4
P1 = [(143, 71, 57), (176, 118, 82), (228, 163, 96), (220, 215, 160), (180, 151, 73), (107, 103, 64)]
P2 = [(43, 51, 158), (13, 219, 204), (59, 118, 216), (67, 235, 255), (0, 58, 118), (0, 148, 251)]
    
    
def convert_points(points):
    if len(points) > 0:
        p = [[int(i) for i in line[:-2].split(',')] for line in points]
        return p
    
def create_p_str(x, y, player):
    if player == 0:
     C = P1
    else:
         C = P2
    i = randint(0, 5)
    p_str = str(int(x)) + ',' + str(int(y))
    for c in C[i]:
        p_str += (',' + str(c))
    return p_str
    
    
def write_point(pt_str, player):
    with open(dir_path + 'p_' + str(player) + '.txt', 'a+') as f:
        f.write(pt_str + '\n')
    with open(dir_path + 'p.txt', 'a+') as f:
        f.write(pt_str + '\n')


def new_game():
    open(dir_path + 'p_0.txt', 'w').close()
    open(dir_path + 'p_1.txt', 'w').close()
    open(dir_path + 'p.txt', 'w').close()
    y = floor(int(H) / 2)
    x_1 = floor(int(W) / 4)
    x_2 = 3 * x_1
    write_point(create_p_str(x_1, y, 0), 0)
    write_point(create_p_str(x_2, y, 1), 1)
    
    


if n_game:
    new_game()


if write:
    write_point(create_p_str(x, y, cur_player), cur_player)

with open(dir_path + 'p_0.txt', 'r') as f:
    p_0 = f.readlines()
    
with open(dir_path + 'p_1.txt', 'r') as f:
    p_1 = f.readlines()



p_0 = convert_points(p_0)
p_1 = convert_points(p_1)
p_0_x = [p[X] for p in p_0]
p_0_y = [p[Y] for p in p_0]
p_0_r = [p[R] for p in p_0]
p_0_g = [p[G] for p in p_0]
p_0_b = [p[B] for p in p_0]

p_1_x = [p[X] for p in p_1]
p_1_y = [p[Y] for p in p_1]
p_1_r = [p[R] for p in p_1]
p_1_g = [p[G] for p in p_1]
p_1_b = [p[B] for p in p_1]
# ---------- end create_voronoi ----------
pt = ConstructPoint(XCoordinate=get_last_point.x, YCoordinate=get_last_point.y, ZCoordinate=0)
pt_2 = ConstructPoint(XCoordinate=create_voronoi.p_0_x, YCoordinate=create_voronoi.p_0_y, ZCoordinate=0)
panel_3 = Panel(pt)
panel_4 = Panel(pt_2)

panel_5 = Panel([process_serial.place_point, process_serial.player])
panel_6 = Panel(process_serial.theta)
pt_3 = ConstructPoint(XCoordinate=pdecon.XComponent, YCoordinate=subtraction, ZCoordinate=pdecon.ZComponent)
vec2pt = Vector2Pt(PointA=pt_3, PointB=pt, Unitize=False)  # -> Vector, Length
number_slider = Slider(6.018, range=0..6.28)
move = Move(Geometry=crv, Motion=vec2pt.Vector)  # -> Geometry, Transform
multiplication = Multiplication(A=process_serial.theta, B="-1")
panel_7 = Panel(create_voronoi.out)
rgb = ColourRGB(Alpha=255, Red=create_voronoi.p_0_r, Green=create_voronoi.p_0_g, Blue=create_voronoi.p_0_b)
rgb_2 = ColourRGB(Alpha=255, Red=create_voronoi.p_1_r, Green=create_voronoi.p_1_g, Blue=create_voronoi.p_1_b)
pt_4 = ConstructPoint(XCoordinate=create_voronoi.p_1_x, YCoordinate=create_voronoi.p_1_y, ZCoordinate=0)
rotate = Rotate(Geometry=move.Geometry, Angle=multiplication, Plane=pt)  # -> Geometry, Transform
brep = Brep(rotate.Geometry)
merge = Merge(Data1=pt_2, Data2=pt_4)
rec = Rectangle({Plane=PlaneXY(50, 50, 0), Size=Domain2(u=-50..50, v=-50..50)})
preview = CustomPreview(Geometry=brep, Material=ColourSwatch(SwatchColor=RGB(255, 255, 255)))
panel_8 = Panel(pt_4)
voronoi = Voronoi(Points=merge, Boundary=rec, BruteForceOverride=False)
brep_2 = Brep(voronoi)
capex = CapHolesEx(Brep=brep_2)  # -> Brep, Caps, Solid
brepsinc = PointInBreps(Brep=capex.Brep, Point=pt_2, Strict=False)  # -> Inside, Index
brepsinc_2 = PointInBreps(Brep=capex.Brep, Point=pt_4, Strict=False)  # -> Inside, Index
item_2 = ListItem(List=capex.Brep, Index=brepsinc.Index, Wrap=True)
area_2 = Area(Geometry=item_2)  # -> Area, Centroid
item_3 = ListItem(List=capex.Brep, Index=brepsinc_2.Index, Wrap=True)
area_3 = Area(Geometry=item_3)  # -> Area, Centroid
preview_2 = CustomPreview(Geometry=item_3, Material=rgb_2)
preview_3 = CustomPreview(Geometry=item_2, Material=rgb)

number_slider_2 = Slider(0.463, range=0..1)
subtraction_2 = Subtraction(A=Slider(1, range=0..1), B=number_slider_2)
num = Number(0.5)
int = Integer(1)

piec_chart_values = Panel([area_3.Area, area_2.Area, number_slider_2, subtraction_2])
outer_circle_radius = Slider(21.584, range=0..30)
inner_circle_radius = Slider(15.178, range=0..30)
label_position = Slider(5.85, range=0..15)
outline_color = ColourSwatch(SwatchColor=RGB(0, 0, 0))
label_color = ColourSwatch(SwatchColor=RGB(0, 0, 0))

ma = MassAddition(Input=piec_chart_values)  # -> Result, PartialResults
division = Division(A=piec_chart_values, B=ma.Result)
ma_2 = MassAddition(Input=division)  # -> Result, PartialResults
cir = Circle(Plane=PlaneXY(0, 0, 0), Radius=outer_circle_radius)
eval = EvaluateCurve(Curve=reparameterize(cir), Parameter=ma_2.PartialResults)  # -> Point, Tangent, Angle
shatter = Shatter(Curve=reparameterize(cir), Parameters=ma_2.PartialResults)
planar = PlanarSrf(Edges=cir)
area_4 = Area(Geometry=cir)  # -> Area, Centroid; disabled
ln = Line(StartPoint=area_4.Centroid, EndPoint=eval.Point)
eval_2 = EvaluateCurve(Curve=reparameterize(shatter), Parameter=num)  # -> Point, Tangent, Angle
vec2pt_2 = Vector2Pt(PointA=area_4.Centroid, PointB=eval_2.Point, Unitize=False)  # -> Vector, Length
srfsplit = SurfaceSplit(Surface=planar, Curves=ln)
cir_2 = Circle(Plane=PlaneXY(0, 0, 0), Radius=inner_circle_radius)  # disabled
amp = Amplitude(Vector=vec2pt_2.Vector, Amplitude=label_position)
srfsplit_2 = SurfaceSplit(Surface=srfsplit, Curves=cir_2)
move_2 = Move(Geometry=eval_2.Point, Motion=amp)  # -> Geometry, Transform
item_4 = ListItem(List=srfsplit_2, Index=int, Wrap=False)  # -> flatten(Element)
vdis = VectorDisplay(Anchor=eval_2.Point, Vector=move_2.Geometry)
tag = TextTag(Location=move_2.Geometry, Text=piec_chart_values, Colour=label_color)
edges = BrepEdges(Brep=item_4)  # -> Naked, Interior, NonManifold
area_5 = Area(Geometry=item_4)  # -> Area, Centroid
preview_4 = CustomPreview(Geometry=edges.Naked, Shader=outline_color)
sort = SortList(Keys=area_5.Area, ValuesA=item_4)  # -> Keys, ValuesA
item_5 = ListItem(List=reverse(sort.Keys), Index=0, Wrap=False)
item_6 = ListItem(List=sort.Keys, Index=0, Wrap=False)  # disabled

gradient = Gradient(
    LowerLimit=item_6,
    UpperLimit=item_5,
    Parameter=sort.Keys,
    stops=[0: RGB(230, 130, 30), 0: RGB(222, 197, 58), 0: RGB(111, 13, 22), 0: RGB(218, 165, 32), 0: RGB(76, 153, 180), 0: RGB(163, 243, 254), 0: RGB(203, 32, 91), 0: RGB(177, 247, 205), 0: RGB(247, 223, 113), 0: RGB(0, 128, 0)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])

preview_5 = CustomPreview(Geometry=sort.ValuesA, Shader=gradient)  # disabled
