# Grasshopper definition gui_gh.gh (Grasshopper 1.0.7)
# plug-ins: gHowl, Firefly.Core

# ---- group: Receive Wekintor output
osc = Panel("999")
porn_num = Panel("12000")
udp = UDPReceiver(Port=porn_num, Pattern=osc)  # -> Info, Data
osc_addresses = Panel("""/wek/outputs
/ output_3
/output_3
/outputs
/1/fader5
/3/xy""")
panel = Panel(udp.Data)
panel_2 = Panel(udp.Info)
osc_c = OSCChannel(OSCMessage=panel)
osc_d = OSCDispatch(OSCDevices=osc_addresses, OSCMessage=panel)  # -> OSCDevice, OSCData
panel_3 = Panel(osc_d.OSCData)
panel_4 = Panel(osc_c)

# ---- group: Read Arduino output from Serial port
timer = Timer(TimerInterval=200, Target=read)
ports_available = COMPortsAvailable()
toggle = BooleanToggle(False)
port_index = Panel("2")
baud_rate = Panel("9600")
item = ListItem(List=ports_available, Index=port_index, Wrap=True)
read = SerialReadGeneric(StartReadingValues=toggle, PortNumber=item)  # -> SerialOutput, StatusMessage
open_port = OpenClosePort(OpenClosePort=toggle, PortNumber=item, BaudRate=baud_rate)
read_errors = Panel(read.StatusMessage)
serial_read = Panel(read.SerialOutput)
open_port_errors = Panel(open_port)

# ----
panel_5 = Panel(ports_available)

# ---- group: Send wekinator output to Processing
port_num = Panel("6000")
txt = Text(panel_3)
osc_2 = Panel("999")
udp_2 = UDPSender(Port=port_num, Pattern=osc_2, Data=txt)
send_errors = Panel(udp_2)

# ---- group: Process data and send to Wekinator
process_serial_input = GhPythonScript(x=serial_read, y="/wek/inputs")  # -> out, a
# ---------- process_serial_input: Python ----------
__author__ = "student"
__version__ = "2019.02.20"

import rhinoscriptsyntax as rs
a = [y] + x.split(',')
# ---------- end process_serial_input ----------
txt_2 = Text(process_serial_input.a)
osc_3 = Panel("999")
port_num_2 = Panel("6448")

# ----
panel_6 = Panel(process_serial_input.a)
udp_3 = UDPSender(Port=port_num_2, Pattern=osc_3, Data=txt_2)

# ---- group: Process data and send to Wekinator (continued)
send_errors_2 = Panel(udp_3)
