# Grasshopper definition piechart.gh (Grasshopper 1.0.7)

number_slider = Slider(0.438, range=0..1)  # disabled
number_slider_2 = Slider(0.45, range=0..1)
number_slider_3 = Slider(0.25, range=0..1)
subtraction = Subtraction(A=Slider(1, range=0..1), B=number_slider_2)
num = Number(0.5)
pt = ConstructPoint(XCoordinate=Slider(-1, range=-1.001..-1), YCoordinate=Slider(1, range=0..1), ZCoordinate=Slider(0, range=0..1))
int = Integer(1)

piec_chart_values = Panel([subtraction, number_slider_2, number_slider])
outer_circle_radius = Slider(0.205, range=0..10)
inner_circle_radius = Slider(0.119, range=0..3)
label_position = Slider(0.028, range=0..0.5)
outline_color = ColourSwatch(SwatchColor=RGB(0, 0, 0))
label_color = ColourSwatch(SwatchColor=RGB(0, 0, 0))

ma = MassAddition(Input=piec_chart_values)  # -> Result, PartialResults
division = Division(A=piec_chart_values, B=ma.Result)
ma_2 = MassAddition(Input=division)  # -> Result, PartialResults
cir = Circle(Plane=PlaneXY(0, 0, 0), Radius=outer_circle_radius)
eval = EvaluateCurve(Curve=reparameterize(cir), Parameter=ma_2.PartialResults)  # -> Point, Tangent, Angle
shatter = Shatter(Curve=reparameterize(cir), Parameters=ma_2.PartialResults)
planar = PlanarSrf(Edges=cir)
area = Area(Geometry=cir)  # -> Area, Centroid
ln = Line(StartPoint=area.Centroid, EndPoint=eval.Point)
eval_2 = EvaluateCurve(Curve=reparameterize(shatter), Parameter=num)  # -> Point, Tangent, Angle
cir_2 = Circle(Plane=PlaneXY(0, 0, 0), Radius=inner_circle_radius)
vec2pt = Vector2Pt(PointA=area.Centroid, PointB=eval_2.Point, Unitize=False)  # -> Vector, Length
srfsplit = SurfaceSplit(Surface=planar, Curves=ln)
move = Move(Geometry=cir_2, Motion=pt)  # -> Geometry, Transform
amp = Amplitude(Vector=vec2pt.Vector, Amplitude=label_position)
srfsplit_2 = SurfaceSplit(Surface=srfsplit, Curves=cir_2)
move_2 = Move(Geometry=eval_2.Point, Motion=amp)  # -> Geometry, Transform
item = ListItem(List=srfsplit_2, Index=int, Wrap=False)  # -> flatten(Element)
move_3 = Move(Geometry=move_2.Geometry, Motion=pt)  # -> Geometry, Transform
vdis = VectorDisplay(Anchor=eval_2.Point, Vector=move_2.Geometry)
tag = TextTag(Location=move_3.Geometry, Text=piec_chart_values, Colour=label_color)
edges = BrepEdges(Brep=item)  # -> Naked, Interior, NonManifold
area_2 = Area(Geometry=item)  # -> Area, Centroid
move_4 = Move(Geometry=edges.Naked, Motion=pt)  # -> Geometry, Transform
sort = SortList(Keys=area_2.Area, ValuesA=item)  # -> Keys, ValuesA
move_5 = Move(Geometry=sort.ValuesA, Motion=pt)  # -> Geometry, Transform
item_2 = ListItem(List=reverse(sort.Keys), Index=0, Wrap=False)
preview = CustomPreview(Geometry=move_4.Geometry, Shader=outline_color)
item_3 = ListItem(List=sort.Keys, Index=0, Wrap=False)

gradient = Gradient(
    LowerLimit=item_3,
    UpperLimit=item_2,
    Parameter=sort.Keys,
    stops=[0: RGB(222, 197, 58), 0: RGB(111, 13, 22), 0: RGB(218, 165, 32), 0: RGB(76, 153, 180), 0: RGB(163, 243, 254), 0: RGB(203, 32, 91), 0: RGB(177, 247, 205), 0: RGB(247, 223, 113), 0: RGB(0, 128, 0), 0.00656: RGB(222, 152, 22)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])

preview_2 = CustomPreview(Geometry=move_5.Geometry, Shader=gradient)
